# Dynamo graph Rhino-to-Revit-Imperial.dyn (Dynamo 1.2.0.2690)

# group: RHINO IMPORTER FOR REVIT PERKINS+WILL
# note: SUPPORT
# Dynamo version: 1.2
# Revit version: 2015, 2016, 2017
# Required Packages: Spring Nodes
# Last Update: 2016.12.08
# Author: Jeremy Luebker
# note: INSTRUCTIONS
# Step 1) Make sure your Rhino geometry are all  close polysurface (extrusions such as boxes  or cylinders do not currently work with this  method).
# Step 2)  Export the geomety as an .SAT file, make  sure your file units are in Feet.
# Step 3) Use the input browse node to navigate and  select the SAT file.
# Step 4)  To execute the import, hit the RUN button  in the lower left corner of the Dynamo  screen.
# Step 5)  Change Default Form Material to have a  poche color and solid fill: in Revit, Manage  > Materials > Graphics
# Step 6) Set the Default Form material to be the default material for the Generic Model Category: in Revit, Manage > Object Styles > Generic Model > Material
# *** NOTE: If you are importing many solids, it may take a little while to import each, so be patient.
# note: NOTES / ISSUES
# This workflow is still very much a work-in-progress and my not work every time. Even if all your Rhino geometry is completely water-tight, they still may not import correctly (it has happened but not often).
# Every solid in the SAT will be imported as a seperate Revit family. Solids can be joined into one family, however, the best practice would be to boolean-union the elements into one solid in rhino before importing.

# group: DESIGN
# note: ________________________________________________________
# FOR BACK-END FUNCTIONALITY

# group: GOOD PRACTICE GUIDELINES
# note: _______________________________________________________
# 1. DIVIDE THE SCRIPT INTO THE USER INTERFACE AND THE BACK-END
# 2. BUILD THE SCRIPT WITH SMALL GROUPS OF NODES
# 3. GROUPS SHOULD ALWAYS HAVE INPUT/OUTPUT
# 4. RENAME INPUT/OUTPUT CONTAINERS TO DATA THEY CARRY
# 5. COLOR-CODE GROUPS ACCORDING TO THE CATEGORIES IN THE TEMPLATE

# group: CONTROL
# note: ________________________________________________________
# FOR USER INPUT (SUCH AS SLIDERS,
#  NUMBERS, ....)

# group: INPUT
# note: ________________________________________________________
# FOR INCOMMING REFFERENCES
# (FILE PATHS, GEOMETRIES...)

# group: OUTPUT
# note: ________________________________________________________
# FOR BLOCKS THAT EXPORT GEOMETRY AND DATA TO EXTERNAL PROGRAMS (INCLUDING REVIT)

# group: MONITOR
# note: ________________________________________________________
# FOR IMPORTANT WATCH NODES

# group: ANNOTATION
# note: ________________________________________________________
# FOR COMMENTS

# group: WIP
# note: ________________________________________________________
# FOR "WORK IN PROGRESS"

# group: Navigate to and select the SAT file. Make sure the file units is in Feet.
file_path = Filename("SAT\scultpture%202.sat")

# group: Import SAT file from link
fromPath = FileObject(file_path)  # "File.FromPath"
importFromSAT = Geometry.ImportFromSAT(fromPath)

# group: Correct SAT import scale bug
meters_feet = CodeBlock { 3.2808; }
scale = Geometry.Scale(geometry=importFromSAT, amount=meters_feet)

code_block = CodeBlock(geo=scale) { geo; }

# group: You can change the name of the family prefix here if you wish.
string = StringInput("ImportedGeometry")

# group: Make a unique name for every solid in the imported file.
code_block_2 = CodeBlock(geo=code_block) { geo; }
indexOf = IndexOf(code_block_2)  # unwired: arg1
map = List.Map(list=code_block_2, f_x=indexOf)
string_from_object = FromObject(map)
concat = String.Concat(string)  # unwired: arg1
map_2 = List.Map(list=string_from_object, f_x=concat)
watch = Watch(map_2)

watch_2 = Watch(code_block)

# group: Add some necessary information to the geometry...
code_block_3 = CodeBlock(geo=code_block) { geo; }
string_2 = StringInput("C:\ProgramData\Autodesk\RVT 2017\Family Templates\English_I\Generic Model.rft")
code_block_4 = CodeBlock(geo_names=map_2) { geo_names; }
categories = Categories("Furniture")
string_3 = StringInput("Default Form")
string_4 = StringInput("C:\ProgramData\Autodesk\RAC 2015\Family Templates\English_I\Generic Model.rft")
string_5 = StringInput("C:\ProgramData\Autodesk\RAC 2015\Family Templates\English_I\Generic Model.rft")

# group: Spring Nodes (with custom addition)
byGeometry = Custom[Springs.FamilyInstance.ByGeometry](geometry=code_block_3, familyTemplatePath=string_2, familyName=code_block_4, category=categories, materialName=string_3)  # You must provide a valid family template path that will be used for all input geometry objects. The project units(and not the templates) will be used to determine the size of the output geometry. The provided category will be used only if the family template supports it. If not, the default template category will be used instead. Likewise, the family material(provided as a string) will be set only if a material with that name exists in the template. If not, the default material will be used instead ("By Category"). For void cuts, the material settings will be ignored. The Subcategory name is an optional input. If you'd like to skip assigning a Subcategory to any new instance, simply use null. The node expects a unique family name for each geometry object. The rest of the input lists will be processed as if the node lacing is set to longest.
